# Grasshopper definition wfc.gh (Grasshopper 1.0.7)
# plug-ins: Centipede, Animation

empty_geom = Geometry()

# ---- group: Input Pattern
panel = Panel("""block
block
block
air
air
air
air
air""")
panel_2 = Panel("""block
block
block
air
air
air
air
air""")
panel_3 = Panel("""block
block
block
block
air
air
air
air""")
panel_4 = Panel("""block
block
block
air
air
air
air
air""")
panel_5 = Panel("""block
block
block
air
air
air
air
air""")
panel_6 = Panel("""block
block
block
air
air
air
air
air""")
panel_7 = Panel("""block
block
block
block
air
air
air
air""")
panel_8 = Panel("""block
block
block
block
air
air
air
air""")
panel_9 = Panel("""block
block
block
air
air
air
air
air""")
panel_10 = Panel("""block
block
block
block
air
air
air
air""")
panel_11 = Panel("""block
block
block
block
air
air
air
air""")
panel_12 = Panel("""block
block
block
air
air
air
air
air""")
panel_13 = Panel("""block
block
block
block
air
air
air
air""")
panel_14 = Panel("""block
block
block
block
block
air
air
air""")
panel_15 = Panel("""block
block
block
block
air
air
air
air""")
panel_16 = Panel("""block
block
block
air
air
air
air
air""")
panel_17 = Panel("""block
block
block
block
air
air
air
air""")
panel_18 = Panel("""block
block
block
block
air
air
air
air""")
panel_19 = Panel("""block
block
block
air
air
air
air
air""")
panel_20 = Panel("""block
block
block
block
air
air
air
air""")
panel_21 = Panel("""block
block
block
block
block
air
air
air""")
panel_22 = Panel("""block
block
block
block
block
air
air
air""")
panel_23 = Panel("""block
block
block
block
block
air
air
air""")
panel_24 = Panel("""block
block
block
block
air
air
air
air""")
panel_25 = Panel("""block
block
block
block
air
air
air
air""")
panel_26 = Panel("""block
block
block
block
air
air
air
air""")
panel_27 = Panel("""block
block
block
block
air
air
air
air""")
panel_28 = Panel("""block
block
block
block
block
air
air
air""")
panel_29 = Panel("""block
block
block
block
block
air
air
air""")
panel_30 = Panel("""block
block
block
block
block
air
air
air""")
panel_31 = Panel("""block
block
block
block
block
air
air
air""")
panel_32 = Panel("""block
block
block
block
air
air
air
air""")
panel_33 = Panel("""block
block
block
block
air
air
air
air""")
panel_34 = Panel("""block
block
block
block
air
air
air
air""")
panel_35 = Panel("""block
block
block
block
block
air
air
air""")
panel_36 = Panel("""block
block
block
block
air
air
air
air""")
panel_37 = Panel("""block
block
block
block
block
air
air
air""")
panel_38 = Panel("""block
block
block
block
block
air
air
air""")
panel_39 = Panel("""block
block
block
block
block
air
air
air""")
panel_40 = Panel("""block
block
block
block
block
air
air
air""")
panel_41 = Panel("""block
block
block
block
air
air
air
air""")
panel_42 = Panel("""block
block
block
block
block
air
air
air""")
panel_43 = Panel("""block
block
block
block
block
air
air
air""")
panel_44 = Panel("""block
block
block
block
air
air
air
air""")
panel_45 = Panel("""block
block
block
block
air
air
air
air""")
panel_46 = Panel("""block
block
block
block
block
open
open
air""")
panel_47 = Panel("""block
block
block
block
block
air
air
air""")
panel_48 = Panel("""block
block
block
block
block
air
air
air""")
panel_49 = Panel("""block
block
block
block
air
air
air
air""")
panel_50 = Panel("""block
block
block
block
open
open
open
col""")
panel_51 = Panel("""block
block
block
block
air
air
air
air""")
panel_52 = Panel("""block
block
block
block
air
air
air
air""")
panel_53 = Panel("""block
block
block
block
block
air
air
air""")
panel_54 = Panel("""block
block
block
block
block
air
air
air""")
panel_55 = Panel("""block
block
block
block
block
air
air
air""")
panel_56 = Panel("""block
block
block
block
block
air
air
air""")
panel_57 = Panel("""block
block
block
block
air
air
air
air""")
panel_58 = Panel("""block
block
block
block
air
air
air
air""")
panel_59 = Panel("""block
block
block
block
air
air
air
air""")
panel_60 = Panel("""block
block
block
block
air
air
air
air""")
panel_61 = Panel("""block
block
block
block
air
air
air
air""")
panel_62 = Panel("""block
block
block
block
air
air
air
air""")
panel_63 = Panel("""block
block
block
block
block
air
air
air""")
panel_64 = Panel("""block
block
block
block
block
air
air
air""")
merge = Merge(
    Data1=panel,
    Data2=panel_12,
    Data3=panel_19,
    Data4=panel_25,
    Data5=panel_36,
    Data6=panel_44,
    Data7=panel_49,
    Data8=panel_57)
merge_2 = Merge(
    Data1=panel_2,
    Data2=panel_9,
    Data3=panel_17,
    Data4=panel_26,
    Data5=panel_33,
    Data6=panel_45,
    Data7=panel_50,
    Data8=panel_58)
merge_3 = Merge(
    Data1=panel_6,
    Data2=panel_10,
    Data3=panel_18,
    Data4=panel_27,
    Data5=panel_34,
    Data6=panel_41,
    Data7=panel_51,
    Data8=panel_59)
merge_4 = Merge(
    Data1=panel_7,
    Data2=panel_13,
    Data3=panel_20,
    Data4=panel_28,
    Data5=panel_37,
    Data6=panel_42,
    Data7=panel_52,
    Data8=panel_60)
merge_5 = Merge(
    Data1=panel_8,
    Data2=panel_14,
    Data3=panel_21,
    Data4=panel_29,
    Data5=panel_35,
    Data6=panel_43,
    Data7=panel_53,
    Data8=panel_61)
merge_6 = Merge(
    Data1=panel_3,
    Data2=panel_15,
    Data3=panel_22,
    Data4=panel_30,
    Data5=panel_38,
    Data6=panel_46,
    Data7=panel_54,
    Data8=panel_62)
merge_7 = Merge(
    Data1=panel_4,
    Data2=panel_11,
    Data3=panel_23,
    Data4=panel_31,
    Data5=panel_39,
    Data6=panel_47,
    Data7=panel_55,
    Data8=panel_63)
merge_8 = Merge(
    Data1=panel_5,
    Data2=panel_16,
    Data3=panel_24,
    Data4=panel_32,
    Data5=panel_40,
    Data6=panel_48,
    Data7=panel_56,
    Data8=panel_64)
merge_9 = Merge(Data1=merge, Data2=merge_2, Data3=merge_3, Data4=merge_4, Data5=merge_5, Data6=merge_6, Data7=merge_7, Data8=merge_8)

# ---- group: Input Map
panel_65 = Panel("""flat
flat
flat
flat
flat
flat
flat
flat""")
panel_66 = Panel("""flat
flat
col
flat
flat
bump
flat
flat""")
panel_67 = Panel("""flat
col
flat
flat
flat
flat
flat
flat""")
panel_68 = Panel("""flat
flat
col
flat
flat
flat
flat
flat""")
panel_69 = Panel("""flat
flat
flat
col
flat
flat
flat
flat""")
panel_70 = Panel("""flat
flat
col
flat
flat
flat
flat
flat""")
panel_71 = Panel("""flat
col
flat
flat
flat
roof
roof
flat""")
panel_72 = Panel("""flat
flat
flat
flat
flat
flat
flat
flat""")

panel_73 = Panel("""flat
flat
flat
flat
flat
flat""")
panel_74 = Panel("""flat
flat
flat
flat
flat
flat""")
panel_75 = Panel("""flat
flat
flat
flat
flat
flat""")
panel_76 = Panel("""flat
roof
roof
roof
flat
flat""")
panel_77 = Panel("""flat
roof
roof
roof
flat
flat""")
panel_78 = Panel("""flat
roof
roof
roof
flat
flat""")

panel_79 = Panel("""flat
flat
flat
flat
flat
flat
flat
flat""")
panel_80 = Panel("""flat
flat
flat
flat
bump
bump
col
col""")
panel_81 = Panel("""flat
flat
flat
flat
bump
bump
col
col""")
panel_82 = Panel("""flat
roof
flat
flat
bump
bump
col
col""")
panel_83 = Panel("""flat
roof
flat
flat
bump
bump
col
col""")
panel_84 = Panel("""flat
roof
flat
flat
bump
bump
col
col""")
panel_85 = Panel("""flat
roof
flat
flat
bump
bump
col
col""")
panel_86 = Panel("""flat
flat
flat
flat
flat
bump
col
col""")

panel_87 = Panel("""roof
roof
bump
roof
roof
roof""")
panel_88 = Panel("""roof
roof
bump
roof
roof
roof""")
panel_89 = Panel("""flat
flat
flat
flat
flat
flat""")
panel_90 = Panel("""roof
roof
bump
roof
roof
roof""")
panel_91 = Panel("""roof
roof
bump
roof
roof
roof""")
panel_92 = Panel("""roof
roof
bump
roof
roof
roof""")

panel_93 = Panel("""col
flat
flat
flat
flat
flat""")
panel_94 = Panel("""col
col
flat
flat
flat
flat""")
panel_95 = Panel("""col
col
col
flat
flat
flat""")
panel_96 = Panel("""col
col
col
roof
flat
flat""")
panel_97 = Panel("""col
col
col
col
roof
flat""")
panel_98 = Panel("""col
col
col
col
col
roof""")

panel_99 = Panel("""flat
flat
flat
flat
flat
flat""")
panel_100 = Panel("""col
col
col
flat
flat
flat""")
panel_101 = Panel("""flat
flat
col
flat
flat
flat""")
panel_102 = Panel("""flat
flat
col
flat
flat
flat""")
panel_103 = Panel("""flat
flat
col
col
col
col""")
panel_104 = Panel("""flat
flat
flat
flat
flat
flat""")

panel_105 = Panel("""flat
bump
bump
flat
flat
flat""")
panel_106 = Panel("""flat
col
col
col
col
flat""")
panel_107 = Panel("""flat
col
roof
roof
col
bump""")
panel_108 = Panel("""flat
col
roof
roof
col
flat""")
panel_109 = Panel("""bump
col
col
col
col
flat""")
panel_110 = Panel("""flat
flat
flat
flat
flat
flat""")

panel_111 = Panel("""flat
flat
flat
flat
flat
flat""")
panel_112 = Panel("""flat
flat
flat
flat
col
flat""")
panel_113 = Panel("""flat
flat
bump
bump
flat
flat""")
panel_114 = Panel("""bump
bump
roof
roof
bump
bump""")
panel_115 = Panel("""roof
roof
roof
roof
roof
roof""")
panel_116 = Panel("""roof
roof
roof
roof
roof
roof""")

# ----
merge_10 = Merge(Data1=panel_99, Data2=panel_100, Data3=panel_101, Data4=panel_102, Data5=panel_103, Data6=panel_104)
merge_11 = Merge(
    Data1=panel_65,
    Data2=panel_66,
    Data3=panel_67,
    Data4=panel_68,
    Data5=panel_69,
    Data6=panel_70,
    Data7=panel_71,
    Data8=panel_72)
merge_12 = Merge(Data1=panel_73, Data2=panel_74, Data3=panel_75, Data4=panel_76, Data5=panel_77, Data6=panel_78)
merge_13 = Merge(Data1=panel_87, Data2=panel_88, Data3=panel_89, Data4=panel_90, Data5=panel_91, Data6=panel_92)
merge_14 = Merge(Data1=panel_93, Data2=panel_94, Data3=panel_95, Data4=panel_96, Data5=panel_97, Data6=panel_98)
merge_15 = Merge(
    Data1=panel_79,
    Data2=panel_80,
    Data3=panel_81,
    Data4=panel_82,
    Data5=panel_83,
    Data6=panel_84,
    Data7=panel_85,
    Data8=panel_86)
merge_16 = Merge(Data1=panel_105, Data2=panel_106, Data3=panel_107, Data4=panel_108, Data5=panel_109, Data6=panel_110)
merge_17 = Merge(Data1=panel_111, Data2=panel_112, Data3=panel_113, Data4=panel_114, Data5=panel_115, Data6=panel_116)
refresh = Button()
panel_117 = Panel("""block
air
air
air""")
panel_118 = Panel("""block
base
box col
arch a""")
panel_119 = Panel("""block
air
air
air""")
panel_120 = Panel("""block
air
air
air""")

# ---- group: Input Map
panel_121 = Panel("""roof
roof
bump
roof
roof
roof""")
panel_122 = Panel("""roof
roof
bump
roof
roof
roof""")
panel_123 = Panel("""roof
roof
bump
roof
roof
roof""")
panel_124 = Panel("""roof
roof
bump
roof
roof
roof""")
panel_125 = Panel("""roof
roof
bump
roof
roof
roof""")
panel_126 = Panel("""roof
roof
bump
roof
roof
roof""")

panel_127 = Panel("""flat
flat
flat
flat
flat
flat""")
panel_128 = Panel("""flat
flat
flat
flat
flat
flat""")
panel_129 = Panel("""flat
flat
flat
flat
flat
flat""")
panel_130 = Panel("""flat
flat
flat
flat
flat
flat""")
panel_131 = Panel("""flat
flat
flat
flat
flat
flat""")
panel_132 = Panel("""flat
flat
flat
flat
flat
flat""")

panel_133 = Panel("""roof
roof
bump
roof
roof
roof""")
panel_134 = Panel("""roof
roof
bump
roof
roof
roof""")
panel_135 = Panel("""roof
roof
bump
roof
roof
roof""")
panel_136 = Panel("""roof
roof
bump
roof
roof
roof""")
panel_137 = Panel("""roof
roof
bump
roof
roof
roof""")
panel_138 = Panel("""roof
roof
bump
roof
roof
roof""")

panel_139 = Panel("""roof
roof
bump
roof
roof
roof""")
panel_140 = Panel("""roof
roof
bump
roof
roof
roof""")
panel_141 = Panel("""roof
roof
bump
roof
roof
roof""")
panel_142 = Panel("""roof
roof
bump
roof
roof
roof""")
panel_143 = Panel("""roof
roof
bump
roof
roof
roof""")
panel_144 = Panel("""roof
roof
bump
roof
roof
roof""")

panel_145 = Panel("""roof
roof
bump
roof
roof
roof""")
panel_146 = Panel("""roof
roof
bump
roof
roof
roof""")
panel_147 = Panel("""roof
roof
bump
roof
roof
roof""")
panel_148 = Panel("""roof
roof
bump
roof
roof
roof""")
panel_149 = Panel("""roof
roof
bump
roof
roof
roof""")
panel_150 = Panel("""roof
roof
bump
roof
roof
roof""")

panel_151 = Panel("""roof
roof
bump
roof
roof
roof""")
panel_152 = Panel("""roof
roof
bump
roof
roof
roof""")
panel_153 = Panel("""roof
roof
bump
roof
roof
roof""")
panel_154 = Panel("""roof
roof
bump
roof
roof
roof""")
panel_155 = Panel("""roof
roof
bump
roof
roof
roof""")
panel_156 = Panel("""roof
roof
bump
roof
roof
roof""")

panel_157 = Panel("""roof
roof
bump
roof
roof
roof""")
panel_158 = Panel("""roof
roof
bump
roof
roof
roof""")
panel_159 = Panel("""flat
flat
flat
flat
flat
flat""")
panel_160 = Panel("""roof
roof
bump
roof
roof
roof""")
panel_161 = Panel("""roof
roof
bump
roof
roof
roof""")
panel_162 = Panel("""roof
roof
bump
roof
roof
roof""")

panel_163 = Panel("""roof
roof
bump
roof
roof
roof""")
panel_164 = Panel("""roof
roof
bump
roof
roof
roof""")
panel_165 = Panel("""flat
flat
flat
flat
flat
flat""")
panel_166 = Panel("""roof
roof
bump
roof
roof
roof""")
panel_167 = Panel("""roof
roof
bump
roof
roof
roof""")
panel_168 = Panel("""roof
roof
bump
roof
roof
roof""")

panel_169 = Panel("""roof
roof
bump
roof
roof
roof""")
panel_170 = Panel("""roof
roof
bump
roof
roof
roof""")
panel_171 = Panel("""flat
flat
flat
flat
flat
flat""")
panel_172 = Panel("""roof
roof
bump
roof
roof
roof""")
panel_173 = Panel("""roof
roof
bump
roof
roof
roof""")
panel_174 = Panel("""roof
roof
bump
roof
roof
roof""")

panel_175 = Panel("""roof
roof
bump
roof
roof
roof""")
panel_176 = Panel("""roof
roof
bump
roof
roof
roof""")
panel_177 = Panel("""flat
flat
flat
flat
flat
flat""")
panel_178 = Panel("""roof
roof
bump
roof
roof
roof""")
panel_179 = Panel("""roof
roof
bump
roof
roof
roof""")
panel_180 = Panel("""roof
roof
bump
roof
roof
roof""")

panel_181 = Panel("""roof
roof
bump
roof
roof
roof""")
panel_182 = Panel("""roof
roof
bump
roof
roof
roof""")
panel_183 = Panel("""flat
flat
flat
flat
flat
flat""")
panel_184 = Panel("""roof
roof
bump
roof
roof
roof""")
panel_185 = Panel("""roof
roof
bump
roof
roof
roof""")
panel_186 = Panel("""roof
roof
bump
roof
roof
roof""")

panel_187 = Panel("""roof
roof
bump
roof
roof
roof""")
panel_188 = Panel("""roof
roof
bump
roof
roof
roof""")
panel_189 = Panel("""flat
flat
flat
flat
flat
flat""")
panel_190 = Panel("""roof
roof
bump
roof
roof
roof""")
panel_191 = Panel("""roof
roof
bump
roof
roof
roof""")
panel_192 = Panel("""roof
roof
bump
roof
roof
roof""")

# ----
panel_193 = Panel("""block
air
air
air""")
panel_194 = Panel("""block
air
air
box beam""")
panel_195 = Panel("""block
air
air
air""")
panel_196 = Panel("""block
base
arch a
air""")

# ---- group: Input Map
panel_197 = Panel("""roof
roof
bump
roof
roof
roof""")
panel_198 = Panel("""roof
roof
bump
roof
roof
roof""")
panel_199 = Panel("""roof
roof
bump
roof
roof
roof""")
panel_200 = Panel("""flat
flat
flat
flat
flat
flat""")
panel_201 = Panel("""roof
roof
bump
roof
roof
roof""")
panel_202 = Panel("""roof
roof
bump
roof
roof
roof""")

panel_203 = Panel("""flat
flat
flat
flat
flat
flat""")
panel_204 = Panel("""flat
flat
flat
flat
flat
flat""")
panel_205 = Panel("""flat
flat
flat
flat
flat
flat""")
panel_206 = Panel("""flat
flat
flat
flat
flat
flat""")
panel_207 = Panel("""flat
flat
flat
flat
flat
flat""")
panel_208 = Panel("""flat
flat
flat
flat
flat
flat""")

panel_209 = Panel("""roof
roof
bump
roof
roof
roof""")
panel_210 = Panel("""roof
roof
bump
roof
roof
roof""")
panel_211 = Panel("""roof
roof
bump
roof
roof
roof""")
panel_212 = Panel("""flat
flat
flat
flat
flat
flat""")
panel_213 = Panel("""roof
roof
bump
roof
roof
roof""")
panel_214 = Panel("""roof
roof
bump
roof
roof
roof""")

panel_215 = Panel("""roof
roof
bump
roof
roof
roof""")
panel_216 = Panel("""roof
roof
bump
roof
roof
roof""")
panel_217 = Panel("""roof
roof
bump
roof
roof
roof""")
panel_218 = Panel("""flat
flat
flat
flat
flat
flat""")
panel_219 = Panel("""roof
roof
bump
roof
roof
roof""")
panel_220 = Panel("""roof
roof
bump
roof
roof
roof""")

panel_221 = Panel("""roof
roof
bump
roof
roof
roof""")
panel_222 = Panel("""roof
roof
bump
roof
roof
roof""")
panel_223 = Panel("""roof
roof
bump
roof
roof
roof""")
panel_224 = Panel("""flat
flat
flat
flat
flat
flat""")
panel_225 = Panel("""roof
roof
bump
roof
roof
roof""")
panel_226 = Panel("""roof
roof
bump
roof
roof
roof""")

panel_227 = Panel("""roof
roof
bump
roof
roof
roof""")
panel_228 = Panel("""roof
roof
bump
roof
roof
roof""")
panel_229 = Panel("""roof
roof
bump
roof
roof
roof""")
panel_230 = Panel("""flat
flat
flat
flat
flat
flat""")
panel_231 = Panel("""roof
roof
bump
roof
roof
roof""")
panel_232 = Panel("""roof
roof
bump
roof
roof
roof""")

# ----
panel_233 = Panel("""block
air
air
air""")
panel_234 = Panel("""block
air
air
box beam""")
panel_235 = Panel("""block
air
air
air""")
panel_236 = Panel("""block
base
arch b
air""")
panel_237 = Panel("""block
air
air
air""")
panel_238 = Panel("""block
base
box col
arch b""")
panel_239 = Panel("""block
air
air
air""")
panel_240 = Panel("""block
air
air
air""")
merge_18 = Merge(Data1=panel_117, Data2=panel_193, Data3=panel_233, Data4=panel_237)
merge_19 = Merge(Data1=panel_118, Data2=panel_194, Data3=panel_234, Data4=panel_238)
merge_20 = Merge(Data1=panel_119, Data2=panel_195, Data3=panel_235, Data4=panel_239)
merge_21 = Merge(Data1=panel_120, Data2=panel_196, Data3=panel_236, Data4=panel_240)
merge_22 = Merge(Data1=panel_121, Data2=panel_122, Data3=panel_123, Data4=panel_124, Data5=panel_125, Data6=panel_126)
merge_23 = Merge(Data1=panel_127, Data2=panel_128, Data3=panel_129, Data4=panel_130, Data5=panel_131, Data6=panel_132)
merge_24 = Merge(Data1=panel_133, Data2=panel_134, Data3=panel_135, Data4=panel_136, Data5=panel_137, Data6=panel_138)
merge_25 = Merge(Data1=panel_139, Data2=panel_140, Data3=panel_141, Data4=panel_142, Data5=panel_143, Data6=panel_144)
merge_26 = Merge(Data1=panel_145, Data2=panel_146, Data3=panel_147, Data4=panel_148, Data5=panel_149, Data6=panel_150)
merge_27 = Merge(Data1=panel_151, Data2=panel_152, Data3=panel_153, Data4=panel_154, Data5=panel_155, Data6=panel_156)
merge_28 = Merge(Data1=panel_157, Data2=panel_158, Data3=panel_159, Data4=panel_160, Data5=panel_161, Data6=panel_162)
merge_29 = Merge(Data1=panel_163, Data2=panel_164, Data3=panel_165, Data4=panel_166, Data5=panel_167, Data6=panel_168)
merge_30 = Merge(Data1=panel_169, Data2=panel_170, Data3=panel_171, Data4=panel_172, Data5=panel_173, Data6=panel_174)
merge_31 = Merge(Data1=panel_175, Data2=panel_176, Data3=panel_177, Data4=panel_178, Data5=panel_179, Data6=panel_180)
merge_32 = Merge(Data1=panel_181, Data2=panel_182, Data3=panel_183, Data4=panel_184, Data5=panel_185, Data6=panel_186)
merge_33 = Merge(Data1=panel_187, Data2=panel_188, Data3=panel_189, Data4=panel_190, Data5=panel_191, Data6=panel_192)
merge_34 = Merge(Data1=panel_197, Data2=panel_198, Data3=panel_199, Data4=panel_200, Data5=panel_201, Data6=panel_202)
merge_35 = Merge(Data1=panel_203, Data2=panel_204, Data3=panel_205, Data4=panel_206, Data5=panel_207, Data6=panel_208)
merge_36 = Merge(Data1=panel_209, Data2=panel_210, Data3=panel_211, Data4=panel_212, Data5=panel_213, Data6=panel_214)
merge_37 = Merge(Data1=panel_215, Data2=panel_216, Data3=panel_217, Data4=panel_218, Data5=panel_219, Data6=panel_220)
merge_38 = Merge(Data1=panel_221, Data2=panel_222, Data3=panel_223, Data4=panel_224, Data5=panel_225, Data6=panel_226)
merge_39 = Merge(Data1=panel_227, Data2=panel_228, Data3=panel_229, Data4=panel_230, Data5=panel_231, Data6=panel_232)
merge_40 = Merge(Data1=merge_19, Data2=merge_20, Data3=merge_21, Data4=merge_18)

# ---- group: .gif Animation
centi = Centipede(startv="0", endv="4968", fstart="0", fend="4968", fprogress=Slider(785, range=0..4968))
save_frames = BooleanToggle(False)
geo = Geometry()
mfr = MaterialFromRhino(Name="Texture")
sf = SaveFrames(On=save_frames, Geometry=geo, Material=mfr, Directory="C:\Users\Drew\Desktop\Wave FC gh\Animation\GH Out")

# ----
merge_41 = Merge(Data1=merge_26, Data2=merge_22, Data3=merge_23, Data4=merge_24, Data5=merge_25, Data6=merge_27)
merge_42 = Merge(Data1=merge_32, Data2=merge_28, Data3=merge_29, Data4=merge_30, Data5=merge_31, Data6=merge_33)
merge_43 = Merge(Data1=merge_38, Data2=merge_34, Data3=merge_35, Data4=merge_36, Data5=merge_37, Data6=merge_39)
panel_241 = Panel("""block
air
air
air""")
panel_242 = Panel("""block
air
air
air""")
panel_243 = Panel("""flat
flat
flat
bump""")
panel_244 = Panel("""flat
flat
flat
bump""")
panel_245 = Panel("""block
air
air
air""")
panel_246 = Panel("""block
air
air
air""")
panel_247 = Panel("""flat
flat
flat
bump""")
panel_248 = Panel("""flat
flat
flat
bump""")
panel_249 = Panel("""block
air
air
air""")
panel_250 = Panel("""block
open
col
air""")
panel_251 = Panel("""flat
flat
flat
bump""")
panel_252 = Panel("""flat
col
col
col""")
panel_253 = Panel("""block
open
air
air""")
panel_254 = Panel("""block
air
air
air""")
panel_255 = Panel("""flat
col
col
col""")
panel_256 = Panel("""flat
flat
flat
bump""")
panel_257 = Panel("""block
block
air
air
air
air
air
air
air""")
panel_258 = Panel("""block
block
block
base
box col
box col
box col
arch y1
air""")
panel_259 = Panel("""block
block
air
air
air
air
air
air
air""")
panel_260 = Panel("""block
block
air
air
air
air
air
air
air""")
panel_261 = Panel("""block
block
block
air
air
air
air
air
air""")
panel_262 = Panel("""block
block
block
air
air
air
air
air
air""")
panel_263 = Panel("""block
block
block
air
air
air
air
air
air""")
panel_264 = Panel("""block
block
block
air
air
air
air
air
air""")
panel_265 = Panel("""block
air
air
air""")
panel_266 = Panel("""block
open
air
air""")
panel_267 = Panel("""flat
flat
flat
bump""")
panel_268 = Panel("""flat
col
col
col""")
panel_269 = Panel("""block
open
air
air""")
panel_270 = Panel("""block
air
air
air""")
panel_271 = Panel("""flat
col
col
col""")
panel_272 = Panel("""flat
flat
flat
bump""")
panel_273 = Panel("""block
air
air
air""")
panel_274 = Panel("""block
air
air
air""")
panel_275 = Panel("""flat
flat
flat
bump""")
panel_276 = Panel("""flat
flat
flat
bump""")
panel_277 = Panel("""block
air
air
air""")
panel_278 = Panel("""block
air
air
air""")
panel_279 = Panel("""flat
flat
flat
bump""")
panel_280 = Panel("""flat
flat
flat
bump""")
panel_281 = Panel("""block
block
air
air
air
air
air
air
air""")
panel_282 = Panel("""block
block
block
air
air
air
air
box beam y
air""")
panel_283 = Panel("""block
block
air
air
air
air
air
air
air""")
panel_284 = Panel("""block
block
air
air
air
air
air
air
air""")
panel_285 = Panel("""block
block
block
air
air
air
air
air
air""")
panel_286 = Panel("""block
block
block
air
air
air
air
air
air""")
panel_287 = Panel("""block
block
block
air
air
air
air
air
air""")
panel_288 = Panel("""block
block
block
air
air
air
air
air
air""")
merge_44 = Merge(Data1=panel_241, Data2=panel_249, Data3=panel_265, Data4=panel_273)
merge_45 = Merge(Data1=panel_242, Data2=panel_250, Data3=panel_266, Data4=panel_274)
merge_46 = Merge(Data1=panel_243, Data2=panel_251, Data3=panel_267, Data4=panel_275)
merge_47 = Merge(Data1=panel_244, Data2=panel_252, Data3=panel_268, Data4=panel_276)
merge_48 = Merge(Data1=panel_245, Data2=panel_253, Data3=panel_269, Data4=panel_277)
merge_49 = Merge(Data1=panel_246, Data2=panel_254, Data3=panel_270, Data4=panel_278)
merge_50 = Merge(Data1=panel_247, Data2=panel_255, Data3=panel_271, Data4=panel_279)
merge_51 = Merge(Data1=panel_248, Data2=panel_256, Data3=panel_272, Data4=panel_280)
panel_289 = Panel("""block
block
air
air
air
air
air
air
air""")
panel_290 = Panel("""block
block
block
air
air
air
air
box beam y
air""")
panel_291 = Panel("""block
block
air
air
air
air
air
air
air""")
panel_292 = Panel("""block
block
air
air
air
air
air
air
air""")
panel_293 = Panel("""block
block
block
air
air
air
air
air
air""")
panel_294 = Panel("""block
block
block
air
air
air
air
air
air""")
panel_295 = Panel("""block
block
block
air
air
air
air
air
air""")
panel_296 = Panel("""block
block
block
air
air
air
air
air
air""")
panel_297 = Panel("""block
block
block
air
air
air
air
air
air""")
panel_298 = Panel("""block
block
block
air
air
air
air
box beam y
air""")
panel_299 = Panel("""block
block
block
air
air
air
air
air
air""")
panel_300 = Panel("""block
block
block
air
air
air
air
air
air""")
panel_301 = Panel("""block
block
block
air
air
air
air
air
air""")
panel_302 = Panel("""block
block
block
air
air
air
air
air
air""")
panel_303 = Panel("""block
block
block
air
air
air
air
air
air""")
panel_304 = Panel("""block
block
block
air
air
air
air
air
air""")
merge_52 = Merge(Data1=merge_44, Data2=merge_45, Data3=merge_48, Data4=merge_49)
merge_53 = Merge(Data1=merge_46, Data2=merge_47, Data3=merge_50, Data4=merge_51)
panel_305 = Panel("""block
block
block
base
box col
box col
arch x2
air
air""")
panel_306 = Panel("""block
block
block
air
air
air
box beam x
box beam y
air""")
panel_307 = Panel("""block
block
block
air
air
air
air
air
air""")
panel_308 = Panel("""block
block
block
air
air
air
box beam x
air
air""")
panel_309 = Panel("""block
block
block
air
air
air
box beam x
air
air""")
panel_310 = Panel("""block
block
block
box col
box col
box col
arch x1
air
air""")
panel_311 = Panel("""block
block
block
air
air
air
box beam x
air
air""")
panel_312 = Panel("""block
block
block
air
air
air
box beam x
air
air""")
panel_313 = Panel("""block
block
block
air
air
air
air
air
air""")
panel_314 = Panel("""block
block
block
air
air
air
air
box beam y
air""")
panel_315 = Panel("""block
block
block
air
air
air
air
air
air""")
panel_316 = Panel("""block
block
block
air
air
air
air
air
air""")
panel_317 = Panel("""block
block
block
air
air
air
air
air
air""")
panel_318 = Panel("""block
block
block
air
air
air
air
air
air""")
panel_319 = Panel("""block
block
block
air
air
air
air
air
air""")
panel_320 = Panel("""block
block
block
air
air
air
air
air
air""")
panel_321 = Panel("""block
block
block
air
air
air
air
air
air""")
panel_322 = Panel("""block
block
block
box col
box col
box col
box col
arch y2
air""")
panel_323 = Panel("""block
block
block
air
air
air
air
air
air""")
panel_324 = Panel("""block
block
block
air
air
air
air
air
air""")
panel_325 = Panel("""block
block
block
air
air
air
air
air
air""")
panel_326 = Panel("""block
block
block
air
air
air
air
air
air""")
panel_327 = Panel("""block
block
block
air
air
air
air
air
air""")
panel_328 = Panel("""block
block
block
air
air
air
air
air
air""")
panel_329 = Panel("""block
block
block
air
air
air
air
air
air""")
panel_330 = Panel("""block
block
block
air
air
air
air
air
air""")
panel_331 = Panel("""block
block
block
air
air
air
air
air
air""")
panel_332 = Panel("""block
block
block
air
air
air
air
air
air""")
panel_333 = Panel("""block
block
block
air
air
air
air
air
air""")
panel_334 = Panel("""block
block
block
air
air
air
air
air
air""")
panel_335 = Panel("""block
block
block
air
air
air
air
air
air""")
panel_336 = Panel("""block
block
block
air
air
air
air
air
air""")
panel_337 = Panel("""block
air
air
air
air
air
air
air
block""")
panel_338 = Panel("""block
air
air
air
air
air
air
air
block""")
panel_339 = Panel("""block
air
air
air
air
air
air
air
block""")
panel_340 = Panel("""block
air
air
air
air
air
air
air
block""")
panel_341 = Panel("""block
air
air
air
air
air
air
air
block""")
panel_342 = Panel("""block
air
air
air
air
air
air
air
block""")
panel_343 = Panel("""block
air
air
air
air
air
air
air
block""")
panel_344 = Panel("""block
open
bump
air
air
air
air
air
block""")
merge_54 = Merge(
    Data1=panel_257,
    Data2=panel_281,
    Data3=panel_289,
    Data4=panel_297,
    Data5=panel_305,
    Data6=panel_313,
    Data7=panel_321,
    Data8=panel_329)
panel_345 = Panel("""block
base
box col
box col
box col
box col
box col
box col
block""")
merge_55 = Merge(
    Data1=panel_258,
    Data2=panel_282,
    Data3=panel_290,
    Data4=panel_298,
    Data5=panel_306,
    Data6=panel_314,
    Data7=panel_322,
    Data8=panel_330)
merge_56 = Merge(
    Data1=panel_259,
    Data2=panel_283,
    Data3=panel_291,
    Data4=panel_299,
    Data5=panel_307,
    Data6=panel_315,
    Data7=panel_323,
    Data8=panel_331)
panel_346 = Panel("""block
air
air
air
air
air
air
air
block""")
merge_57 = Merge(
    Data1=panel_260,
    Data2=panel_284,
    Data3=panel_292,
    Data4=panel_300,
    Data5=panel_308,
    Data6=panel_316,
    Data7=panel_324,
    Data8=panel_332)
merge_58 = Merge(
    Data1=panel_261,
    Data2=panel_285,
    Data3=panel_293,
    Data4=panel_301,
    Data5=panel_309,
    Data6=panel_317,
    Data7=panel_326,
    Data8=panel_333)
panel_347 = Panel("""block
air
air
air
air
air
air
air
block""")
panel_348 = Panel("""block
base
box col
box col
box col
box col
box col
box col
block""")
panel_349 = Panel("""block
base
box col
box col
box col
box col
box col
box col
block""")
merge_59 = Merge(
    Data1=panel_262,
    Data2=panel_286,
    Data3=panel_294,
    Data4=panel_302,
    Data5=panel_310,
    Data6=panel_318,
    Data7=panel_325,
    Data8=panel_334)
panel_350 = Panel("""block
air
air
air
air
air
air
air
block""")
merge_60 = Merge(
    Data1=panel_263,
    Data2=panel_287,
    Data3=panel_295,
    Data4=panel_303,
    Data5=panel_311,
    Data6=panel_319,
    Data7=panel_327,
    Data8=panel_335)
panel_351 = Panel("""block
air
air
air
air
air
air
air
block""")
merge_61 = Merge(
    Data1=panel_264,
    Data2=panel_288,
    Data3=panel_296,
    Data4=panel_304,
    Data5=panel_312,
    Data6=panel_320,
    Data7=panel_328,
    Data8=panel_336)
panel_352 = Panel("""block
air
air
air
air
air
air
air
block""")
panel_353 = Panel("""block
air
air
air
air
air
air
air
block""")
panel_354 = Panel("""block
air
air
air
air
air
air
air
block""")
panel_355 = Panel("""block
air
air
air
air
air
air
air
block""")
panel_356 = Panel("""block
air
air
air
air
air
air
air
block""")
panel_357 = Panel("""block
air
air
air
air
air
air
air
block""")
panel_358 = Panel("""block
air
air
air
air
air
air
air
block""")
panel_359 = Panel("""block
air
air
air
air
air
air
air
block""")
panel_360 = Panel("""block
air
air
air
air
air
air
air
block""")
panel_361 = Panel("""block
air
air
air
air
air
air
air
block""")
panel_362 = Panel("""block
air
air
air
air
air
air
air
block""")
panel_363 = Panel("""block
air
air
air
air
air
air
air
block""")
panel_364 = Panel("""block
air
air
air
air
air
air
air
block""")
panel_365 = Panel("""block
air
air
air
air
air
air
air
block""")
panel_366 = Panel("""block
bump
air
air
air
air
air
air
block""")
panel_367 = Panel("""block
open
air
air
air
air
air
air
block""")
panel_368 = Panel("""block
air
air
air
air
air
air
air
block""")
panel_369 = Panel("""block
air
air
air
air
air
air
air
block""")
panel_370 = Panel("""block
air
air
air
air
air
air
air
block""")
panel_371 = Panel("""block
air
air
air
air
air
air
air
block""")
panel_372 = Panel("""block
bump
air
air
air
air
air
air
block""")
panel_373 = Panel("""block
air
air
air
air
air
air
air
block""")
panel_374 = Panel("""block
air
air
air
air
air
air
air
block""")
panel_375 = Panel("""block
air
air
air
air
air
air
air
block""")
panel_376 = Panel("""block
air
air
air
air
air
air
air
block""")
panel_377 = Panel("""block
base
box col
box col
box col
box col
box col
box col
block""")
panel_378 = Panel("""block
air
air
air
air
air
air
air
block""")
panel_379 = Panel("""block
air
air
air
air
air
air
air
block""")
panel_380 = Panel("""block
air
air
air
air
air
air
air
block""")
panel_381 = Panel("""block
air
air
air
air
air
air
air
block""")
panel_382 = Panel("""block
air
air
air
air
air
air
air
block""")
panel_383 = Panel("""block
base
box col
box col
box col
box col
box col
box col
block""")
panel_384 = Panel("""block
air
air
air
air
air
air
air
block""")
panel_385 = Panel("""block
air
air
air
air
air
air
air
block""")
panel_386 = Panel("""block
air
air
air
air
air
air
air
block""")
panel_387 = Panel("""block
air
air
air
air
air
air
air
block""")
panel_388 = Panel("""block
open
air
air
air
air
air
air
block""")
panel_389 = Panel("""block
air
air
air
air
air
air
air
block""")
panel_390 = Panel("""block
air
air
air
air
air
air
air
block""")
panel_391 = Panel("""block
base
box col
box col
box col
box col
box col
box col
block""")
panel_392 = Panel("""block
air
air
air
air
air
air
air
block""")
merge_62 = Merge(
    Data1=merge_59,
    Data2=merge_58,
    Data3=merge_55,
    Data4=merge_61,
    Data5=merge_60,
    Data6=merge_57,
    Data7=merge_54,
    Data8=merge_56)
panel_393 = Panel("""block
air
air
air
air
air
air
air
block""")
panel_394 = Panel("""block
air
air
air
air
air
air
air
block""")
panel_395 = Panel("""block
air
air
air
air
air
air
air
block""")
panel_396 = Panel("""block
air
air
air
air
air
air
air
block""")
panel_397 = Panel("""block
air
air
air
air
air
air
air
block""")
panel_398 = Panel("""block
air
air
air
air
air
air
air
block""")
panel_399 = Panel("""block
air
air
air
air
air
air
air
block""")
panel_400 = Panel("""block
air
air
air
air
air
air
air
block""")
merge_63 = Merge(
    Data1=panel_337,
    Data2=panel_345,
    Data3=panel_353,
    Data4=panel_361,
    Data5=panel_369,
    Data6=panel_377,
    Data7=panel_385,
    Data8=panel_393)
merge_64 = Merge(
    Data1=panel_339,
    Data2=panel_347,
    Data3=panel_357,
    Data4=panel_366,
    Data5=panel_374,
    Data6=panel_380,
    Data7=panel_390,
    Data8=panel_398)
merge_65 = Merge(
    Data1=panel_338,
    Data2=panel_346,
    Data3=panel_354,
    Data4=panel_362,
    Data5=panel_370,
    Data6=panel_378,
    Data7=panel_386,
    Data8=panel_394)
merge_66 = Merge(
    Data1=panel_340,
    Data2=panel_348,
    Data3=panel_355,
    Data4=panel_363,
    Data5=panel_371,
    Data6=panel_379,
    Data7=panel_387,
    Data8=panel_395)
merge_67 = Merge(
    Data1=panel_341,
    Data2=panel_349,
    Data3=panel_356,
    Data4=panel_367,
    Data5=panel_376,
    Data6=panel_383,
    Data7=panel_391,
    Data8=panel_399)
merge_68 = Merge(
    Data1=panel_342,
    Data2=panel_350,
    Data3=panel_358,
    Data4=panel_368,
    Data5=panel_375,
    Data6=panel_384,
    Data7=panel_392,
    Data8=panel_400)
merge_69 = Merge(
    Data1=panel_343,
    Data2=panel_351,
    Data3=panel_359,
    Data4=panel_364,
    Data5=panel_372,
    Data6=panel_381,
    Data7=panel_388,
    Data8=panel_396)
merge_70 = Merge(
    Data1=panel_344,
    Data2=panel_352,
    Data3=panel_360,
    Data4=panel_365,
    Data5=panel_373,
    Data6=panel_382,
    Data7=panel_389,
    Data8=panel_397)
merge_71 = Merge(
    Data1=merge_68,
    Data2=merge_67,
    Data3=merge_64,
    Data4=merge_70,
    Data5=merge_69,
    Data6=merge_66,
    Data7=merge_63,
    Data8=merge_65)
panel_401 = Panel(merge_71)

geo_2 = Geometry(<brep referenced from the Rhino model>)
pt = Point(Point(0, 0, 0))
geo_3 = Geometry([<brep referenced from the Rhino model> x2])
pt_2 = Point(Point(10, 0, 0))
geo_4 = Geometry([<brep referenced from the Rhino model> x2])
pt_3 = Point(Point(20, 0, 0))
geo_5 = Geometry([<brep referenced from the Rhino model> x3])
pt_4 = Point(Point(30, 0, 0))
geo_6 = Geometry([<curve referenced from the Rhino model> x24])
pt_5 = Point(Point(40, 0, 0))
geo_7 = Geometry(<brep referenced from the Rhino model>)
pt_6 = Point(Point(50, 0, 0))
geo_8 = Geometry(<brep referenced from the Rhino model>)
pt_7 = Point(Point(60, 0, 0))
geo_9 = Geometry(<brep referenced from the Rhino model>)
pt_8 = Point(Point(70, 0, 0))
geo_10 = Geometry(<brep referenced from the Rhino model>)
pt_9 = Point(Point(70, 0, 10))
geo_11 = Geometry(<brep referenced from the Rhino model>)
pt_10 = Point(Point(80, 0, 10))
geo_12 = Geometry(<brep referenced from the Rhino model>)
pt_11 = Point(Point(80, 0, 0))
geo_13 = Geometry(<brep referenced from the Rhino model>)
pt_12 = Point(Point(90, 0, 0))
geo_14 = Geometry(<brep referenced from the Rhino model>)
pt_13 = Point(Point(100, 0, 0))
geo_15 = Geometry(<brep referenced from the Rhino model>)
pt_14 = Point(Point(110, 0, 0))
geo_16 = Geometry(<brep referenced from the Rhino model>)
pt_15 = Point(Point(120, 0, 0))
wfc_tile = WfcTile(name="flat", geom=geo_2, reforigin=pt)
wfc_tile_2 = WfcTile(name="bump", geom=geo_3, reforigin=pt_2)
wfc_tile_3 = WfcTile(name="col", geom=geo_4, reforigin=pt_3)
wfc_tile_4 = WfcTile(name="roof", geom=geo_5, reforigin=pt_4)
wfc_tile_5 = WfcTile(name="air", geom=geo_6, reforigin=pt_5)
wfc_tile_6 = WfcTile(name="block", geom=geo_7, reforigin=pt_6)
wfc_tile_7 = WfcTile(name="open", geom=geo_8, reforigin=pt_7)
wfc_tile_8 = WfcTile(name="base", geom=geo_9, reforigin=pt_8)
wfc_tile_9 = WfcTile(name="arch y1", geom=geo_10, reforigin=pt_9)
wfc_tile_10 = WfcTile(name="arch y2", geom=geo_11, reforigin=pt_10)
wfc_tile_11 = WfcTile(name="box col", geom=geo_12, reforigin=pt_11)
wfc_tile_12 = WfcTile(name="box beam y", geom=geo_13, reforigin=pt_12)
wfc_tile_13 = WfcTile(name="arch x1", geom=geo_14, reforigin=pt_13)
wfc_tile_14 = WfcTile(name="arch x2", geom=geo_15, reforigin=pt_14)
wfc_tile_15 = WfcTile(name="box beam x", geom=geo_16, reforigin=pt_15)

wfc_tile_16 = WfcTile(name="block a", geom=geo_7, reforigin=pt_6)
wfc_tile_17 = WfcTile(name="block b", geom=geo_7, reforigin=pt_6)

merge_72 = Merge(
    Data1=wfc_tile,
    Data2=wfc_tile_2,
    Data3=wfc_tile_3,
    Data4=wfc_tile_4,
    Data5=wfc_tile_5,
    Data6=wfc_tile_6,
    Data7=wfc_tile_7,
    Data8=wfc_tile_8,
    Data9=wfc_tile_9,
    Data10=wfc_tile_10,
    Data11=wfc_tile_11,
    Data12=wfc_tile_12,
    Data13=wfc_tile_13,
    Data14=wfc_tile_14,
    Data15=wfc_tile_15,
    Data16=wfc_tile_16,
    Data17=wfc_tile_17)
module_name = CSharpScript(module=merge_72, Reference="C:\Users\Drew\Desktop\Dev\wfc lib\gh_WFC_lib\obj\Debug\gh_WFC_lib.dll")  # -> name
# ---------- module_name: C# ----------
    Module m = (Module) _module;
    name = m.TypeName;
# ---------- end module_name ----------
panel_402 = Panel(module_name)

# ---- group: Initiate grid instance
geo_17 = Geometry(<curve referenced from the Rhino model>)
pt_16 = Point(Point(0, -20, 0))
inputextentsz = Slider(9, range=0..10)
extentsz = Slider(16, range=0..100)
wfc_tile_18 = WfcTile(name="default", geom=geo_17, reforigin=pt_16)
create_grid = CSharpScript(
    extentsX=Slider(16, range=0..100),
    extentsY=Slider(16, range=0..100),
    extentsZ=extentsz,
    inputExtentsX=Slider(8, range=0..10),
    inputExtentsY=Slider(8, range=0..10),
    inputExtentsZ=inputextentsz,
    modules=merge_72,
    pattern=merge_71,
    defMod=wfc_tile_18,
    refresh=refresh,
    Reference="C:\Users\Drew\Desktop\Dev\wfc lib\gh_WFC_lib\obj\Debug\gh_WFC_lib.dll")  # -> grid, log; inputs modules: list, pattern: list
# ---------- create_grid: C# ----------
    GHLogger ghl = new GHLogger();
    int eX = Convert.ToInt32(extentsX);
    int eY = Convert.ToInt32(extentsY);
    int eZ = Convert.ToInt32(extentsZ);
    int iX = Convert.ToInt32(inputExtentsX);
    int iY = Convert.ToInt32(inputExtentsY);
    int iZ = Convert.ToInt32(inputExtentsZ);
    List<Module> allModules = new List<Module>();
    Module df = (Module) _defMod;
    foreach (object o in _modules)
    {
      Module m = (Module) o;
      if (_pattern.Contains(m.TypeName) && !allModules.Contains(m))
      {
        allModules.Add(m);
      }
    }
    Grid3d g = new Grid3d(eX, eY, eZ, iX, iY, iZ, allModules, df, ghl);
    grid = g;
    log = ghl;
# ---------- end create_grid ----------

# ---- group: Solve grid instance
entropyselection = Slider(0.1, range=0..1)
solve_grid = CSharpScript(
    grid=create_grid.grid,
    pattern=merge_71,
    pSize=Slider(3, range=1..6),
    allowInputTileX=Toggle(True),
    allowInputTileY=Toggle(True),
    allowInputTileZ=Toggle(False),
    allowOutputTileX=Toggle(False),
    allowOutputTileY=Toggle(False),
    allowOutputTileZ=Toggle(False),
    solveAttempts=Slider(500, range=0..10000),
    seed=Slider(-5917, range=-1000000..1000000),
    entropySelection=entropyselection,
    Reference="C:\Users\Drew\Desktop\Dev\wfc lib\gh_WFC_lib\obj\Debug\gh_WFC_lib.dll")  # -> G, log; inputs pattern: list
# ---------- solve_grid: C# ----------
    Grid3d g = (Grid3d) _grid;
    bool allowInputTileX = (bool) _allowInputTileX;
    bool allowInputTileY = (bool) _allowInputTileY;
    bool allowInputTileZ = (bool) _allowInputTileZ;

    bool allowOutputTileX = (bool) _allowOutputTileX;
    bool allowOutputTileY = (bool) _allowOutputTileY;
    bool allowOutputTileZ = (bool) _allowOutputTileZ;

    string[,,] mapStr = new string[g.IX, g.IY, g.IZ];
    int i = 0;
    for (int x = 0; x < g.IX; x++)
    {
      for (int y = 0; y < g.IY; y++)
      {
        for (int z = 0; z < g.IZ; z++)
        {
          mapStr.SetValue((string) _pattern[i], x, y, z);
          i++;
        }
      }
    }
    int ps = Convert.ToInt32(_pSize);
    int sa = Convert.ToInt32(_solveAttempts);
    int sd = Convert.ToInt32(_seed);
    float est = (float) Convert.ToDouble(_entropySelection);

    Module[,,] m = g.Solve(mapStr, ps, allowInputTileX, allowInputTileY, allowInputTileZ, allowOutputTileX, allowOutputTileY, allowOutputTileZ, sa, sd, est);
    G = g;
    log = g.GHL;
# ---------- end solve_grid ----------

# ---- group: Model Results
number_slider = Slider(10, range=0..10)
number_slider_2 = Slider(10, range=0..10)
zsize = Slider(10, range=0..10)
pt_17 = Point(Point(150, 0, 0))
pt_18 = Point(<point referenced from the Rhino model>)
bake_and_animate_state = CSharpScript(
    origin=pt_17,
    xSize=number_slider,
    ySize=number_slider_2,
    zSize=zsize,
    grid=solve_grid.G,
    state=centi,
    Reference="C:\Users\Drew\Desktop\Dev\wfc lib\gh_WFC_lib\obj\Debug\gh_WFC_lib.dll")  # -> resultGrid, log; disabled
# ---------- bake_and_animate_state: C# ----------
    Point3d op = (Point3d) _origin;
    int sx = Convert.ToInt32(_xSize);
    int sy = Convert.ToInt32(_ySize);
    int sz = Convert.ToInt32(_zSize);
    Grid3d G = (Grid3d) _grid;
    List<GeometryBase> result = new List<GeometryBase>();
    List<string> _log = new List<String>();
    int stateIndex = Convert.ToInt32(_state);

    int gX = G.cellCollapseOrder[stateIndex].X;
    int gY = G.cellCollapseOrder[stateIndex].Y;
    int gZ = G.cellCollapseOrder[stateIndex].Z;
    Cell3d c = G.GetCell(gX, gY, gZ);
    Point3d target = new Point3d(op.X + (sx * gX), op.Y + (sy * gY), op.Z + (sz * gZ));
    Module m = G.GetCellModuleInState(gX, gY, gZ, stateIndex);
    Vector3d move = target - m.refOrigin;
    if (m.Geom.Count > 0)
    {
      _log.Add(m.TypeName);
      foreach (GeometryBase gb in m.Geom)
      {
        _log.Add(".");
        GeometryBase g = gb.Duplicate();
        g.Translate(move);
        Rhino.RhinoDoc.ActiveDoc.Objects.Add(g);
        result.Add(g);
      }
    }


    /*for (int x = 0; x < G.EX; x++)
    {
      for (int y = 0; y < G.EY; y++)
      {
        for (int z = 0; z < G.EZ; z++)
        {
          Point3d target = new Point3d(op.X + (sx * x), op.Y + (sy * y), op.Z + (sz * z));
          Vector3d move = target - G.GetCellModuleInState(x, y, z, stateIndex).refOrigin;
          if (G.GetCellModuleInState(x, y, z, stateIndex).Geom.Count > 0)
          {
            _log.Add(G.GetCellModuleInState(x, y, z, stateIndex).TypeName);
            foreach (GeometryBase gb in G.GetCellModuleInState(x, y, z, stateIndex).Geom)
            {
              _log.Add(".");
              GeometryBase g = gb.Duplicate();
              g.Translate(move);
              result.Add(g);
            }
          }
        }
      }
    }*/
    log = _log;
    resultGrid = result;
# ---------- end bake_and_animate_state ----------
model_state = CSharpScript(
    origin=pt_17,
    xSize=number_slider,
    ySize=number_slider_2,
    zSize=zsize,
    grid=solve_grid.G,
    Reference="C:\Users\Drew\Desktop\Dev\wfc lib\gh_WFC_lib\obj\Debug\gh_WFC_lib.dll")  # -> resultGrid, log
# ---------- model_state: C# ----------
    Point3d op = (Point3d) _origin;
    int sx = Convert.ToInt32(_xSize);
    int sy = Convert.ToInt32(_ySize);
    int sz = Convert.ToInt32(_zSize);
    Grid3d G = (Grid3d) _grid;
    List<GeometryBase> result = new List<GeometryBase>();
    List<string> _log = new List<String>();
    int stateIndex = Convert.ToInt32(_state);

    for (int x = 0; x < G.EX; x++)
    {
      for (int y = 0; y < G.EY; y++)
      {
        for (int z = 0; z < G.EZ; z++)
        {
          Point3d target = new Point3d(op.X + (sx * x), op.Y + (sy * y), op.Z + (sz * z));
          Vector3d move = target - G.GetCellModuleInState(x, y, z, stateIndex).refOrigin;
          if (G.GetCellModuleInState(x, y, z, stateIndex).Geom.Count > 0)
          {
            _log.Add(G.GetCellModuleInState(x, y, z, stateIndex).TypeName);
            foreach (GeometryBase gb in G.GetCellModuleInState(x, y, z, stateIndex).Geom)
            {
              _log.Add(".");
              GeometryBase g = gb.Duplicate();
              g.Translate(move);
              result.Add(g);
            }
          }
        }
      }
    }
    log = _log;
    resultGrid = result;
# ---------- end model_state ----------
model_result = CSharpScript(
    origin=pt_17,
    xSize=number_slider,
    ySize=number_slider_2,
    zSize=zsize,
    grid=solve_grid.G,
    Reference="C:\Users\Drew\Desktop\Dev\wfc lib\gh_WFC_lib\obj\Debug\gh_WFC_lib.dll")  # -> resultGrid, log
# ---------- model_result: C# ----------
    Point3d op = (Point3d) _origin;
    int sx = Convert.ToInt32(_xSize);
    int sy = Convert.ToInt32(_ySize);
    int sz = Convert.ToInt32(_zSize);
    Grid3d G = (Grid3d) _grid;
    List<GeometryBase> result = new List<GeometryBase>();
    List<string> _log = new List<String>();

    //List<Point3d> tp = new List<Point3d>();
    //List<Line> tc = new List<Line>();

    for (int x = 0; x < G.EX; x++)
    {
      for (int y = 0; y < G.EY; y++)
      {
        for (int z = 0; z < G.EZ; z++)
        {
          if (G.GetCell(x, y, z).CModule != null)
          {
            Point3d target = new Point3d(op.X + (sx * x), op.Y + (sy * y), op.Z + (sz * z));
            Vector3d move = target - G.GetCell(x, y, z).CModule.refOrigin;
            if (G.GetCell(x, y, z).CModule.Geom.Count > 0)
            {
              _log.Add(G.GetCell(x, y, z).CModule.TypeName);
              foreach (GeometryBase gb in G.GetCell(x, y, z).CModule.Geom)
              {
                _log.Add(".");
                GeometryBase g = gb.Duplicate();
                g.Translate(move);
                result.Add(g);
              }
            }
          }
          else
          {
            Point3d target = new Point3d(op.X + (sx * x), op.Y + (sy * y), op.Z + (sz * z));
            Vector3d move = target - G.DefaultModule.refOrigin;
            if (G.DefaultModule.Geom.Count > 0)
            {
              _log.Add("default");
              foreach (GeometryBase gb in G.DefaultModule.Geom)
              {
                _log.Add(".");
                GeometryBase g = gb.Duplicate();
                g.Translate(move);
                result.Add(g);
              }
            }
          }
        }
      }
    }
    //A = tc;
    //B = tp;
    log = _log;
    resultGrid = result;
# ---------- end model_result ----------
model_input = CSharpScript(
    origin=pt_18,
    xSize=number_slider,
    ySize=number_slider_2,
    zSize=zsize,
    grid=solve_grid.G,
    Reference="C:\Users\Drew\Desktop\Dev\wfc lib\gh_WFC_lib\obj\Debug\gh_WFC_lib.dll")  # -> resultGrid, log
# ---------- model_input: C# ----------
    Point3d op = (Point3d) _origin;
    int sx = Convert.ToInt32(_xSize);
    int sy = Convert.ToInt32(_ySize);
    int sz = Convert.ToInt32(_zSize);
    Grid3d G = (Grid3d) _grid;
    List<GeometryBase> result = new List<GeometryBase>();
    List<string> _log = new List<String>();

    //List<Point3d> tp = new List<Point3d>();
    //List<Line> tc = new List<Line>();

    for (int x = 0; x < G.IX; x++)
    {
      for (int y = 0; y < G.IY; y++)
      {
        for (int z = 0; z < G.IZ; z++)
        {
          Point3d target = new Point3d(op.X + (sx * x), op.Y + (sy * y), op.Z + (sz * z));
          Vector3d move = target - G.InputMap[x, y, z].refOrigin;
          if (G.InputMap[x, y, z].Geom.Count > 0)
          {
            _log.Add(G.InputMap[x, y, z].TypeName);
            foreach (GeometryBase gb in G.InputMap[x, y, z].Geom)
            {
              _log.Add(".");
              GeometryBase g = gb.Duplicate();
              g.Translate(move);
              result.Add(g);
            }
          }
        }
      }
    }
    //A = tc;
    //B = tp;
    log = _log;
    resultGrid = result;
# ---------- end model_input ----------

# ---- group: Viewport render preview
geo_18 = Geometry(model_result.resultGrid)
material = CreateMaterial(
    Diffuse=ColourSwatch(SwatchColor=RGB(255, 175, 135)),
    Specular=RGB(255, 255, 255),
    Emission=RGB(0, 0, 0),
    Transparency=0,
    Shine=0)
preview = CustomPreview(Geometry=[geo_18, model_input.resultGrid], Material=material)

# ----
geo_19 = Geometry(model_input.resultGrid)
grid_print = CSharpScript(ghlogger=solve_grid.log, Reference="C:\Users\Drew\Desktop\Dev\wfc lib\gh_WFC_lib\obj\Debug\gh_WFC_lib.dll")  # -> print
# ---------- grid_print: C# ----------
    GHLogger g = (GHLogger) _ghlogger;
    List<string> s = new List<string>();
    foreach (object o in g.GHLog)
    {
      s.Add((string) o);
    }
    print = s;
# ---------- end grid_print ----------
log = Panel(grid_print)

# ==== cluster WfcTile
reforigin = ClusterInput()
geom = ClusterInput()
name = ClusterInput()
create_module = CSharpScript(
    name=name,
    geom=geom,
    refOrigin=reforigin,
    Reference="C:\Users\Drew\Desktop\Dev\wfc lib\gh_WFC_lib\obj\Debug\gh_WFC_lib.dll")  # -> module; inputs geom: list
# ---------- create_module: C# usings ----------
using gh_WFC_lib;
# ---------- create_module: C# ----------
    //cast objects to more specific types
    List <GeometryBase> geom = new List<GeometryBase>();
    foreach (object g in _geom)
    {
      GeometryBase gb = (GeometryBase) g;
      geom.Add(gb.Duplicate());
    }
    string name = (string) _name;
    Point3d ro = (Point3d) _refOrigin;
    //output
    module = new Module(name, geom, 0, ro);
# ---------- end create_module ----------
module = ClusterOutput(create_module)
